# Grasshopper definition neuro-space.gh (Grasshopper 1.0.8)
# plug-ins: Parakeet, Flexibility

wall_count = GetNumber(Slider(5, range=3..8), AtLeast=1, AtMost=1, Maximum=1.797693135e+308, Minimum=-1.797693135e+308, TreeAccess=False)

xy_plane = XYPlane(Origin=Point(0, 0, 0))
polygon = Polygon(Plane=xy_plane, Radius=Slider(80, range=20..80), Segments=wall_count, FilletRadius=0)  # -> Polygon, Length
deconstruct_brep = DeconstructBrep(Brep=polygon.Polygon)  # -> Faces, Edges, Vertices
curve_middle = CurveMiddle(Curve=deconstruct_brep.Edges)

# ---- group: curvature
wall_curvature = GetNumber(
    Slider(0.79, range=0.7..0.95),
    AtLeast=1,
    AtMost=1,
    Maximum=1.797693135e+308,
    Minimum=-1.797693135e+308,
    TreeAccess=False)

# ----
polyline = PolyLine(Vertices=curve_middle, Closed=Toggle(True))
area = Area(Geometry=polyline)  # -> Area, Centroid
scale = Scale(Geometry=polyline, Center=area.Centroid, Factor=wall_curvature)  # -> Geometry, Transform
deconstruct_brep_2 = DeconstructBrep(Brep=scale.Geometry)  # -> Faces, Edges, Vertices
end_points = EndPoints(Curve=deconstruct_brep.Edges)  # -> Start, End

# ---- group: height
ceiling_height = GetNumber(Slider(7, range=2..15), AtLeast=1, AtMost=1, Maximum=1.797693135e+308, Minimum=-1.797693135e+308, TreeAccess=False)

# ----
merge = Merge(
    Data1=simplify(graft(end_points.Start)),
    Data2=simplify(graft(deconstruct_brep_2.Vertices)),
    Data3=simplify(graft(end_points.End)))
series = Series(Start=0, Step=Slider(10, range=0..10), Count=ceiling_height)
range = Range(Domain=Domain(0, 1), Steps=expr("x-1", ceiling_height))
interpolate = Interpolate(Vertices=merge, Degree=3, Periodic=False, KnotStyle=1)  # -> Curve, Length, Domain
panel = Panel(series)

# ---- group: twist
biophilic_organic_form = GetNumber(Slider(24, range=0..100), AtLeast=1, AtMost=1, Maximum=1.797693135e+308, Minimum=-1.797693135e+308, TreeAccess=False)

# ----
graph_mapper = GraphMapper(range, x0=0, x1=1, y0=0, y1=1, container_name="Sine", Equation_px=[0, 0.503841877], Equation_py=[0, 1])
join_curves = JoinCurves(Curves=flatten(interpolate.Curve), Preserve=False)
unit_z = UnitZ(Factor=panel)
panel_2 = Panel(graph_mapper)
move = Move(Geometry=join_curves, Motion=unit_z)  # -> Geometry, Transform
multiplication = Multiplication(A=panel_2, B=biophilic_organic_form)
panel_3 = Panel(multiplication)
rotate = Rotate(Geometry=move.Geometry, Angle=degrees(panel_3), Plane=PlaneXY(0, 0, 0))  # -> Geometry, Transform

opening_count = GetNumber(Slider(6, range=1..10), AtLeast=1, AtMost=1, Maximum=1.797693135e+308, Minimum=-1.797693135e+308, TreeAccess=False)

loft = Loft(Curves=rotate.Geometry, Options={Adjust=False, Closed=False, LoftEnds=0, LoftSimp=0, LoftType=1, Rebuild=10, Refit=0.01})
list_item = ListItem(List=rotate.Geometry, Index=0, Wrap=True)  # -> Item1, Item
solid_union = SolidUnion(Breps=flatten(loft))
brep = Brep(list_item.Item1)
unit_z_2 = UnitZ(Factor=Slider(1, range=0..10))
offset_brep = OffsetBrep(
    Brep=solid_union,
    Distance=Slider(1, range=0..10),
    Solid=invert(False),
    BothSides=False,
    RoundCorners=True,
    MergeFaces=False)
extrude = Extrude(Base=brep, Direction=unit_z_2)

opening_size = GetNumber(Slider(14, range=5..30), AtLeast=1, AtMost=1, Maximum=1.797693135e+308, Minimum=-1.797693135e+308, TreeAccess=False)

populate_3d = Populate3D(Region=loft, Count=opening_count, Seed=1)
pull_point = PullPoint(Points=flatten(populate_3d), Geometry=loft, Closest=False, Func=True)  # -> flatten(ClosestPoint), Distance
center_box = CenterBox(Base=pull_point.ClosestPoint, X=opening_size, Y=opening_size, Z=opening_size)

panel_4 = Panel(center_box)
solid_difference = SolidDifference(BrepsA=[offset_brep, extrude], BrepsB=center_box)
mesh_brep = MeshBrep(
    Brep=solid_difference,
    Settings={GridMaxCount=0, GridMinCount=16, JaggedSeams=False, MaxEdgeLength=0, MinEdgeLength=0.0001, MinTolerance=0, Refine=True, RefineAngle=0, RelativeTolerance=0.65, SimplePlanes=True, Tolerance=0})
custom_preview = CustomPreview(Geometry=mesh_brep, Material=ColourSwatch(SwatchColor=RGB(204, 0, 0)))
context_bake = ContextBake(Content=mesh_brep)
